# Dynamo custom node LunchBox Wall Element Collector cn.dyf "LunchBox Wall Element Collector" (Dynamo 0.8.0.950)
# category: LunchBox.Revit.Elements
# Collects wall elements from the Revit document.

Wall_Types = Input()
Parameter_Names = Input()
python_script = Python(IN[0]=Wall_Types, IN[1]=Parameter_Names)
# ---------- python_script.python (86 lines) ----------
#Copyright(c) 2014, Nathan Miller
# The Proving Ground, http://theprovingground.org

import clr

clr.AddReference("RevitAPI")
import Autodesk
from Autodesk.Revit.DB import *

clr.AddReference("RevitServices")
import RevitServices
from RevitServices.Persistence import DocumentManager

clr.AddReference("RevitNodes")
import Revit

clr.ImportExtensions(Revit.Elements)


def getpara(para):
	ptype=para.StorageType
	if ptype==StorageType.String:
		paravalue=para.AsString()
	else:
		paravalue=para.AsValueString()	
	return paravalue

walltypes = UnwrapElement(IN[0])
paranames=IN[1]

doc = DocumentManager.Instance.CurrentDBDocument
typelist = []
output = []
walls = []
locations = []
elementids = []
paraset = []
flag0= 0 if walltypes is None else 1
flag1= 0 if paranames is None else 1


if flag0:
	for item in walltypes:
		typelist.append(item.Id)

if flag1:
	for i in range(len(paranames)):
		paraset.append([])
		
collector = FilteredElementCollector(doc)
collector.OfCategory(BuiltInCategory.OST_Walls)
collector.OfClass(Wall)

famtypeitr = collector.GetElementIdIterator()
famtypeitr.Reset()

for item in famtypeitr:
	inst = doc.GetElement(item)
	
	if flag0==0:
		loc = Revit.GeometryConversion.RevitToProtoCurve.ToProtoType(inst.Location.Curve, True )
		if flag1:
			for i in range(len(paranames)):
				paraset[i].append(getpara(inst.Parameter[paranames[i]]))
		
		walls.append(inst)
		locations.append(loc)
		elementids.append(inst.Id.ToString())  
	
	elif inst.WallType.Id in typelist:
		loc = Revit.GeometryConversion.RevitToProtoCurve.ToProtoType(inst.Location.Curve, True )
		if flag1:
			for i in range(len(paranames)):
				paraset[i].append(getpara(inst.Parameter[paranames[i]]))
				
		walls.append(inst)
		locations.append(loc)
		elementids.append(inst.Id.ToString())

output.append(walls)
output.append(locations)
output.append(elementids)
if flag1:
	output.append(paraset)	
        
OUT = output
# ----------------------------------------
code_block = CodeBlock { 0; 1; 2; 3; }
getItemAtIndex = List.GetItemAtIndex(list=python_script, index=code_block.out0)
Element = Output(getItemAtIndex)
solids = Element.Solids(getItemAtIndex, lacing=Longest)
Solid = Output(solids)
getItemAtIndex_2 = List.GetItemAtIndex(list=python_script, index=code_block.out1)
Location_Curve = Output(getItemAtIndex_2)
getItemAtIndex_3 = List.GetItemAtIndex(list=python_script, index=code_block.out2)
ElementID = Output(getItemAtIndex_3)
getItemAtIndex_4 = List.GetItemAtIndex(list=python_script, index=code_block.out3)
Parameters = Output(getItemAtIndex_4)
